% Simulink data dictionary data.sldd

RatePower = fan.Parameter(4000, DoubleProperty=0, Int32Property=int32(0), LogicalProperty=false, OnOffCharProperty="off", ColorCharProperty="red", DataType="double")
RateSpeed = fan.Parameter(304.734, DoubleProperty=0, Int32Property=int32(0), LogicalProperty=false, OnOffCharProperty="off", ColorCharProperty="red", DataType="double")
RateTorque = fan.Parameter(13.126, DoubleProperty=0, Int32Property=int32(0), LogicalProperty=false, OnOffCharProperty="off", ColorCharProperty="red", DataType="double")
T0 = fan.Parameter(0.6563, DoubleProperty=0, Int32Property=int32(0), LogicalProperty=false, OnOffCharProperty="off", ColorCharProperty="red", DataType="double")
a = fan.Parameter(0.000134, DoubleProperty=0, Int32Property=int32(0), LogicalProperty=false, OnOffCharProperty="off", ColorCharProperty="red", DataType="double")
J_total = fan.Parameter(0.35, DoubleProperty=0, Int32Property=int32(0), LogicalProperty=false, OnOffCharProperty="off", ColorCharProperty="red", DataType="double")
J_f = fan.Parameter(0.05, DoubleProperty=0, Int32Property=int32(0), LogicalProperty=false, OnOffCharProperty="off", ColorCharProperty="red", DataType="double")
J_m = fan.Parameter(0.3, DoubleProperty=0, Int32Property=int32(0), LogicalProperty=false, OnOffCharProperty="off", ColorCharProperty="red", DataType="double")
PID_P = Simulink.Parameter(0.06, StorageClass="ExportedGlobal", DataType="double")
PID_I = Simulink.Parameter(0.03, StorageClass="ExportedGlobal", DataType="double")
Actual_Speed = fan.Signal(DoubleProperty=0, Int32Property=int32(0), LogicalProperty=false, OnOffCharProperty="off", ColorCharProperty="red", StorageClass="ImportedExtern", DataType="double")
PID_aP = fan.Signal(DoubleProperty=0, Int32Property=int32(0), LogicalProperty=false, OnOffCharProperty="off", ColorCharProperty="red", InitialValue="0.06", DataType="double")
PID_aI = fan.Signal(DoubleProperty=0, Int32Property=int32(0), LogicalProperty=false, OnOffCharProperty="off", ColorCharProperty="red", InitialValue="PID_I", DataType="double")
Sig = Simulink.Signal()
Torque_Control = fan.Signal(DoubleProperty=0, Int32Property=int32(0), LogicalProperty=false, OnOffCharProperty="off", ColorCharProperty="red", InitialValue="0", DataType="double")
Torque_max = fan.Parameter(26.25, DoubleProperty=0, Int32Property=int32(0), LogicalProperty=false, OnOffCharProperty="off", ColorCharProperty="red", StorageClass="Define", DataType="double")
Speed_max = fan.Parameter(437.03, DoubleProperty=0, Int32Property=int32(0), LogicalProperty=false, OnOffCharProperty="off", ColorCharProperty="red", StorageClass="Define", DataType="double")

ControlPerformanceStruct = Simulink.Bus()
  risingtime: double
  stabletime: double
  overshoot: double

Performance_OverShoot = fan.Parameter(3.747796, DoubleProperty=0, Int32Property=int32(0), LogicalProperty=false, OnOffCharProperty="off", ColorCharProperty="red", StorageClass="ImportedExtern", DataType="double")
Performance_RisingTime = fan.Parameter(17.40868, DoubleProperty=0, Int32Property=int32(0), LogicalProperty=false, OnOffCharProperty="off", ColorCharProperty="red", StorageClass="ImportedExtern", DataType="double")
Performance_StableTime = fan.Parameter(27.1164, DoubleProperty=0, Int32Property=int32(0), LogicalProperty=false, OnOffCharProperty="off", ColorCharProperty="red", StorageClass="ExportedGlobal", DataType="double")
Reference_Speed = fan.Parameter(344.8513, DoubleProperty=0, Int32Property=int32(0), LogicalProperty=false, OnOffCharProperty="off", ColorCharProperty="red", StorageClass="ImportedExtern", DataType="double")